# Dynamo graph Areas to mass_190514.dyn (Dynamo 2.0.2.6826)

categories = Categories(index=425)  # graph input
all_elements_of_category = ElementsOfCategory(Category=categories)
geometry = Element.Geometry(element=all_elements_of_category)
flatten = List.Flatten(list=geometry)
categories_2 = Categories(index=276)  # graph input
code_block = CodeBlock { "Level"; "Name"; }
getParameterValueByName = Element.GetParameterValueByName(element=all_elements_of_category, parameterName=code_block.out0)
id = Element.Id(element=all_elements_of_category)
getParameterValueByName_2 = Element.GetParameterValueByName(element=all_elements_of_category, parameterName=code_block.out1)
code_block_2 = CodeBlock { "Number"; }
getParameterValueByName_3 = Element.GetParameterValueByName(element=all_elements_of_category, parameterName=code_block_2)
code_block_3 = CodeBlock(lev=getParameterValueByName, idn=id, nam=getParameterValueByName_2, num=getParameterValueByName_3) { lev+"_"+idn+"_"+nam+"_"+num; }
# note: Sprins Package
ꟿ_directshape_bygeometry = Custom[ꟿ DirectShape.ByGeometry](geometry=flatten, category=categories_2, name=code_block_3)  # Convert the input geometry to DirectShape element inside the Revit document. It supports solids or surfaces. It is based on an alternative process that uses a SAT import and can produce smooth surfaces. Each created DS will have a unique type. Make sure that each input geometry has a unique name. You can either feed a single category for all geometries or a unique category for each geometry - the node's lacing is set to longest by default. The default category is Generic Models.
parameters = Element.Parameters(element=ꟿ_directshape_bygeometry)
code_block_4 = CodeBlock { " "; "_"; }
replace = String.Replace(str=code_block_3, searchFor=code_block_4.out0, replaceWith=code_block_4.out1)
categories_3 = Categories(index=74)  # graph input
all_elements_of_category_2 = ElementsOfCategory(Category=categories_3)
code_block_5 = CodeBlock { "Level"; "Name"; }
getParameterValueByName_4 = Element.GetParameterValueByName(element=all_elements_of_category_2, parameterName=code_block_5.out0)
id_2 = Element.Id(element=all_elements_of_category_2)
getParameterValueByName_5 = Element.GetParameterValueByName(element=all_elements_of_category_2, parameterName=code_block_5.out1)
code_block_6 = CodeBlock { "Number"; }
getParameterValueByName_6 = Element.GetParameterValueByName(element=all_elements_of_category_2, parameterName=code_block_6)
code_block_7 = CodeBlock(lev=getParameterValueByName_4, idn=id_2, nam=getParameterValueByName_5, num=getParameterValueByName_6) { lev+"_"+idn+"_"+nam+"_"+num; }
code_block_8 = CodeBlock { " "; "_"; }
replace_2 = String.Replace(str=code_block_7, searchFor=code_block_8.out0, replaceWith=code_block_8.out1)
code_block_9 = CodeBlock { 4000; }
ʳʰʸᵗʰᵐ_areas_solid = Rhythm.Revit.Elements.Areas.Solid(area=all_elements_of_category_2, areaHeight=code_block_9)
categories_4 = Categories(index=276)  # graph input
ꟿ_directshape_bygeometry_2 = Custom[ꟿ DirectShape.ByGeometry](geometry=ʳʰʸᵗʰᵐ_areas_solid, category=categories_4, name=code_block_7)
byGeometry = DirectShape.ByGeometry(geometry=ʳʰʸᵗʰᵐ_areas_solid, category=categories_4, name=code_block_7)
parameters_2 = Element.Parameters(element=byGeometry)
parameters_3 = Element.Parameters(element=all_elements_of_category_2)
byGeometry_2 = DirectShape.ByGeometry(geometry=flatten, category=categories_2, name=code_block_3)
parameters_4 = Element.Parameters(element=byGeometry_2)
