# Dynamo graph Data_StringifyJSON.dyn (Dynamo 3.2.2.5494)

# group: 번역 오류?Dynamo에서 Data.StringifyJSON 및 Data.Remember 노드 언마스킹
# note: https://dynamobim.org/lost-in-translation-unmasking-data-stringifyjson-and-data-remember-nodes-in-dynamo/

code_block = CodeBlock { x=(1..100..10); Point.ByCoordinates(x,0,10); }

# group: Geometry.ToSolidDef
file_path = Filename("D:\OneDrive\dynamo\Data_StringifyJSON\Geometry_ToSolidDef.txt")
toSolidDef = Geometry.ToSolidDef(geometry=code_block.out1)
writeText = FileSystem.WriteText(text=toSolidDef)  # unwired: filePath

# group: Data.StringifyJSON
stringifyJSON = Data.StringifyJSON(values=code_block.out1)
writeText_2 = FileSystem.WriteText(text=stringifyJSON)  # unwired: filePath
file_path_2 = Filename("D:\OneDrive\dynamo\Data_StringifyJSON\DataStringifyJSON.txt")

watch = Watch(stringifyJSON)
concat = String.Concat(string0=toSolidDef)
watch_2 = Watch(concat)
readText = FileSystem.ReadText(file=file_path_2)
parseJSON = Data.ParseJSON(json=readText)
writeText_3 = FileSystem.WriteText(text=concat)  # unwired: filePath
file_path_3 = Filename(".\Geometry_ToSolidDef_joinString.txt")
string = StringInput(",")
join = String.Join(separator=string, string0=toSolidDef)
code_block_2 = CodeBlock(x=join) { "["+ x + "]"; }
writeText_4 = FileSystem.WriteText(text=code_block_2)  # unwired: filePath
file_path_4 = Filename(".\Geometry_ToSolidDef_concateString.txt")
string_from_array = FromArray(array=toSolidDef)
writeText_5 = FileSystem.WriteText(text=string_from_array)  # unwired: filePath
file_path_5 = Filename(".\Geometry_ToSolidDef_StringFromArray.txt")
readText_2 = FileSystem.ReadText(file=file_path_5)
parseJSON_2 = Data.ParseJSON(json=readText_2)
flatten = List.Flatten(list=parseJSON_2)
