# Dynamo graph familyTransform.dyn (Dynamo 3.2.1.5366)

select_model_element = DSModelElementSelection()  # 1 picked in the model
getLocation = Element.GetLocation(element=select_model_element)
now = DateTime.Now()
components = DateTime.Components(dateTime=now)
number_slider = DoubleSlider(176, range=-1000..1000 step 1)
code_block = CodeBlock(time=components.hour, increase=number_slider) { time+increase; }
number_slider_2 = DoubleSlider(10, range=0..100 step 0.1)
mul = code_block * number_slider_2
number_slider_3 = DoubleSlider(-56.9, range=-100..100 step 0.1)
mul_2 = number_slider_3 * number_slider_2
number_slider_4 = DoubleSlider(0, range=0..100 step 0.1)
mul_3 = number_slider_4 * number_slider_2
translate = Geometry.Translate(geometry=getLocation, xTranslation=mul, yTranslation=mul_2, zTranslation=mul_3)
setLocation = Element.SetLocation(element=select_model_element, geometry=translate)
select_model_element_2 = DSModelElementSelection()  # 1 picked in the model
start = Revit.Transaction.Transaction.Start(input=select_model_element_2)
number_slider_5 = DoubleSlider(-57.3, range=-100..100 step 0.1)
byCoordinates = Vector.ByCoordinates(x=number_slider_5, y=number_slider_5)
moveByVector = Element.MoveByVector(element=start, vector=byCoordinates)

# group: 
# Inserted Dynamo graph
select_model_element_3 = DSModelElementSelection()  # 1 picked in the model
start_2 = Revit.Transaction.Transaction.Start(input=select_model_element_3)
getLocation_2 = Element.GetLocation(element=select_model_element_3)
number_slider_6 = DoubleSlider(241, range=-1000..1000 step 1)
code_block_2 = CodeBlock(time=components.hour, increase=number_slider_6) { time+increase; }
number_slider_7 = DoubleSlider(12, range=-1000..1000 step 1)
translate_2 = Geometry.Translate(geometry=getLocation_2, xTranslation=code_block_2, yTranslation=number_slider_7)
byTwoPoints = Vector.ByTwoPoints(start=getLocation_2, end=translate_2)
moveByVector_2 = Element.MoveByVector(element=start_2, vector=byTwoPoints)
number = DoubleInput(-200)
geometry = Element.Geometry(element=select_model_element_3)
